# Grasshopper definition Tools Definition Example.gh (Grasshopper 1.0.7)

# ----
# Cross Lap Ortho Clamp - CL1
# The clamp type. Identifyable id name.
# Mesh Geometry of the parallel gripper. Base Mesh is attached to the robot (e.g. gripper body, spacer, quick changer)
# Geometry of the Left Body (between jaw and base) modeled at closed state, this part opens towards -neg Y direction as the gripper attach clamp to timber.
# Geometry of the Right Body modeled at closed state, this part opens towards +pos Y direction.
# Geometry of the Left Clamp Jaw modeled at closed state, this jaw open towards +pos Z direction.
# Geometry of the Right Clamp Jaw modeled at closed state, this jaw open towards +pos Z direction.
# Gripper (attach clamp to timber) operation distance limit of each jaw.
# Min = Closed Position
# Max = Open Position
# Clamp (joint closure) operation distance limit of each jaw.
# Min = Closed Position
# Max = Open Position
# Tool Coordinate Frame (TCF) where the clamp is attached to the joint, in relation to T0CF
# Position where the robot (T0CF) needs to reach before picking up tool during tool change . (in relation to T0CF)
# Location (frame) where the tool (TCF) is stored (in WCF) during fabrication
# Vector for gripper to approach beam
# Vector for robot to detach the clamp after joint is assembled. (in relation to T0CF)
xy = XYPlane(Origin=Point(0, 0, 0))
geo = Geometry(<brep referenced from the Rhino model>)
geo_2 = Geometry(<brep referenced from the Rhino model>)
geo_3 = Geometry(<brep referenced from the Rhino model>)
min_closed_position_typ_0 = Slider(0, range=0..200)
max_open_position = Slider(20, range=0..200)
min_closed_position_typ_0_2 = Slider(0, range=0..200)
max_open_position_2 = Slider(120, range=0..200)
pt = Point(<point referenced from the Rhino model>)
pt_2 = Point(<point referenced from the Rhino model>)
geo_4 = Geometry(<brep referenced from the Rhino model>)
geo_5 = Geometry(<brep referenced from the Rhino model>)
xy_2 = XYPlane(Origin=pt_2)
xy_3 = XYPlane(Origin=pt)
mesh = Mesh(geo_4)
mesh_2 = Mesh(geo_3)
mesh_3 = Mesh(geo_5)
mesh_4 = Mesh(geo)
mesh_5 = Mesh(geo_2)
vec = Vector("{0,0,-180}")
vec_2 = Vector("{-120,0,-5}")
Z = UnitZ(Factor=Slider(105, range=0..1000))
create_clamp = GhPythonScript(
    type_name="CL1",
    base_mesh=mesh_4,
    l_body_mesh=mesh_5,
    r_body_mesh=mesh,
    l_jaw_mesh=mesh_2,
    r_jaw_mesh=mesh_3,
    gripper_jaw_position_min=min_closed_position_typ_0,
    gripper_jaw_position_max=max_open_position,
    clamp_jaw_position_min=min_closed_position_typ_0_2,
    clamp_jaw_position_max=max_open_position_2,
    tool_coordinate_frame=xy_3,
    tool_pick_up_frame=xy_2,
    tool_storage_frame=xy,
    approach_vector=Z,
    detachretract1_vector=vec_2,
    detachretract2_vector=vec)  # -> out, visual, robot_model; inputs base_mesh: Mesh, l_body_mesh: Mesh, r_body_mesh: Mesh, l_jaw_mesh: Mesh, r_jaw_mesh: Mesh, tool_coordinate_frame: Plane, tool_pick_up_frame: Plane, tool_storage_frame: Plane, approach_vector: Vector3d, detachretract1_vector: Vector3d, detachretract2_vector: Vector3d
# ---------- create_clamp: Python ----------
#from compas_ghpython import unload_modules
#unload_modules("integral_timber_joints")

from compas.geometry import Frame
from compas_rhino.geometry import RhinoPlane, RhinoMesh, RhinoVector
from integral_timber_joints.tools import Lap90ClampFactory

from compas_ghpython.helpers import mesh_draw

tool_coordinate_frame = RhinoPlane.from_geometry(tool_coordinate_frame).to_compas()
tool_pick_up_frame = RhinoPlane.from_geometry(tool_pick_up_frame).to_compas()
tool_storage_frame = RhinoPlane.from_geometry(tool_storage_frame).to_compas()
mesh_gripper_base = RhinoMesh.from_geometry(base_mesh).to_compas()
mesh_gripper_jaw_l = RhinoMesh.from_geometry(l_body_mesh).to_compas()
mesh_gripper_jaw_r = RhinoMesh.from_geometry(r_body_mesh).to_compas()
mesh_clamp_jaw_l = RhinoMesh.from_geometry(l_jaw_mesh).to_compas()
mesh_clamp_jaw_r = RhinoMesh.from_geometry(r_jaw_mesh).to_compas()
approach_vector = RhinoVector.from_geometry(approach_vector).to_compas()
detachretract1_vector = RhinoVector.from_geometry(detachretract1_vector).to_compas()
detachretract2_vector = RhinoVector.from_geometry(detachretract2_vector).to_compas()

robot_model = Lap90ClampFactory(
    None,
    type_name,
    gripper_jaw_position_min,
    gripper_jaw_position_max,
    clamp_jaw_position_min,
    clamp_jaw_position_max,
    tool_coordinate_frame = tool_coordinate_frame,
    tool_pick_up_frame = tool_pick_up_frame,
    tool_storage_frame = tool_storage_frame,
    mesh_gripper_base = mesh_gripper_base,
    mesh_gripper_jaw_l = mesh_gripper_jaw_l,
    mesh_gripper_jaw_r = mesh_gripper_jaw_r,
    mesh_clamp_jaw_l = mesh_clamp_jaw_l,
    mesh_clamp_jaw_r = mesh_clamp_jaw_r,
    approach_vector = approach_vector,
    detachretract1_vector = detachretract1_vector,
    detachretract2_vector = detachretract2_vector,
    )
# ---------- end create_clamp ----------

# ----
# Development Tools
# Reload Python Modules (if Module Code is Changed)
python_module_to_reload = Panel("""compas
compas_fab
roslibpy
integral_timber_joints""")
reload = Button()
py = PythonScript(reload_module_button=reload, module_names=python_module_to_reload)  # inputs module_names: list
# ---------- py: Python ----------
import compas_ghpython
from compas_ghpython import unload_modules
if reload_module_button:
    for module in module_names:
        unload_modules(module)
# ---------- end py ----------

# ----
# Parallel Gripper - PG2
# The gripper type. Identifyable id name.
# Mesh Geometry of the parallel gripper. Base Mesh is attached to the robot (e.g. gripper body, spacer, quick changer)
# Geometry of the Left Jaw modeled at closed state, this jaw open towards -neg Y direction.
# Geometry of the Right Jaw modeled at closed state, this jaw open towards +pos Y direction.
# Jaw operation distance limit of each jaw.
# Min = Closed Position
# Max = Open Position
# Tool Coordinate Frame (TCF) where the beam is held, in relation to T0CF
# Position where the robot (T0CF) needs to reach before picking up tool during tool change . (in relation to T0CF)
# Location (frame) where the tool (TCF) is stored (in WCF) during fabrication
# Vector for gripper to approach beam
xy_4 = XYPlane(Origin=Point(0, 0, 0))
geo_6 = Geometry(<mesh referenced from the Rhino model>)
geo_7 = Geometry(<mesh referenced from the Rhino model>)
geo_8 = Geometry(<mesh referenced from the Rhino model>)
max_open_position_3 = Slider(20, range=0..200)
pt_3 = Point(<point referenced from the Rhino model>)
pt_4 = Point(<point referenced from the Rhino model>)
min_closed_position_typ_0_3 = Slider(0, range=0..200)
xy_5 = XYPlane(Origin=pt_3)
xy_6 = XYPlane(Origin=pt_4)
mesh_6 = Mesh(geo_6)
mesh_7 = Mesh(geo_7)
mesh_8 = Mesh(geo_8)
Z_2 = UnitZ(Factor=Slider(105, range=0..1000))
create_parallel_gripper = GhPythonScript(
    type_name="PG2",
    base_mesh=mesh_6,
    l_jaw_mesh=mesh_7,
    r_jaw_mesh=mesh_8,
    gripper_jaw_position_min=min_closed_position_typ_0_3,
    gripper_jaw_position_max=max_open_position_3,
    tool_coordinate_frame=xy_5,
    tool_pick_up_frame=xy_6,
    tool_storage_frame=xy_4,
    approach_vector=Z_2)  # -> out, robot_model; inputs base_mesh: Mesh, l_jaw_mesh: Mesh, r_jaw_mesh: Mesh, tool_coordinate_frame: Plane, tool_pick_up_frame: Plane, tool_storage_frame: Plane, approach_vector: Vector3d
# ---------- create_parallel_gripper: Python ----------
#from compas_ghpython import unload_modules
#unload_modules("integral_timber_joints")

from compas.geometry import Frame
from compas_rhino.geometry import RhinoPlane, RhinoMesh, RhinoVector
from integral_timber_joints.tools import ParallelGripperFactory

from compas_ghpython.helpers import mesh_draw

tool_coordinate_frame = RhinoPlane.from_geometry(tool_coordinate_frame).to_compas()
tool_pick_up_frame = RhinoPlane.from_geometry(tool_pick_up_frame).to_compas()
tool_storage_frame = RhinoPlane.from_geometry(tool_storage_frame).to_compas()
mesh_gripper_base = RhinoMesh.from_geometry(base_mesh).to_compas()
mesh_gripper_jaw_l = RhinoMesh.from_geometry(l_jaw_mesh).to_compas()
mesh_gripper_jaw_r = RhinoMesh.from_geometry(r_jaw_mesh).to_compas()
approach_vector = RhinoVector.from_geometry(approach_vector).to_compas()

robot_model = ParallelGripperFactory(
    None,
    type_name,
    gripper_jaw_position_min,
    gripper_jaw_position_max,
    tool_coordinate_frame = tool_coordinate_frame,
    tool_pick_up_frame = tool_pick_up_frame,
    tool_storage_frame = tool_storage_frame,
    mesh_gripper_base = mesh_gripper_base,
    mesh_gripper_jaw_l = mesh_gripper_jaw_l,
    mesh_gripper_jaw_r = mesh_gripper_jaw_r,
    approach_vector = approach_vector,
    )
# ---------- end create_parallel_gripper ----------

# ----
# Parallel Gripper - PG1
# The gripper type. Identifyable id name.
# Mesh Geometry of the parallel gripper. Base Mesh is attached to the robot (e.g. gripper body, spacer, quick changer)
# Geometry of the Left Jaw modeled at closed state, this jaw open towards -neg Y direction.
# Geometry of the Right Jaw modeled at closed state, this jaw open towards +pos Y direction.
# Jaw operation distance limit of each jaw.
# Min = Closed Position
# Max = Open Position
# Tool Coordinate Frame (TCF) where the beam is held, in relation to T0CF
# Position where the robot (T0CF) needs to reach before picking up tool during tool change . (in relation to T0CF)
# Location (frame) where the tool (TCF) is stored (in WCF) during fabrication
# Vector for gripper to approach beam
xy_7 = XYPlane(Origin=Point(0, 0, 0))
geo_9 = Geometry(<mesh referenced from the Rhino model>)
geo_10 = Geometry(<mesh referenced from the Rhino model>)
geo_11 = Geometry(<mesh referenced from the Rhino model>)
max_open_position_4 = Slider(20, range=0..200)
pt_5 = Point(<point referenced from the Rhino model>)
pt_6 = Point(<point referenced from the Rhino model>)
min_closed_position_typ_0_4 = Slider(0, range=0..200)
xy_8 = XYPlane(Origin=pt_5)
xy_9 = XYPlane(Origin=pt_6)
mesh_9 = Mesh(geo_9)
mesh_10 = Mesh(geo_10)
mesh_11 = Mesh(geo_11)
Z_3 = UnitZ(Factor=Slider(105, range=0..1000))
create_parallel_gripper_2 = GhPythonScript(
    type_name="PG1",
    base_mesh=mesh_9,
    l_jaw_mesh=mesh_10,
    r_jaw_mesh=mesh_11,
    gripper_jaw_position_min=min_closed_position_typ_0_4,
    gripper_jaw_position_max=max_open_position_4,
    tool_coordinate_frame=xy_8,
    tool_pick_up_frame=xy_9,
    tool_storage_frame=xy_7,
    approach_vector=Z_3)  # -> out, robot_model; inputs base_mesh: Mesh, l_jaw_mesh: Mesh, r_jaw_mesh: Mesh, tool_coordinate_frame: Plane, tool_pick_up_frame: Plane, tool_storage_frame: Plane, approach_vector: Vector3d
# ---------- create_parallel_gripper_2: Python ----------
#from compas_ghpython import unload_modules
#unload_modules("integral_timber_joints")

from compas.geometry import Frame, Vector, Box
from compas.datastructures import Mesh

from compas_rhino.geometry import RhinoPlane, RhinoMesh, RhinoVector
from integral_timber_joints.tools import ParallelGripperFactory

from compas_ghpython.helpers import mesh_draw

tool_coordinate_frame = RhinoPlane.from_geometry(tool_coordinate_frame).to_compas()
tool_pick_up_frame = RhinoPlane.from_geometry(tool_pick_up_frame).to_compas()
tool_storage_frame = RhinoPlane.from_geometry(tool_storage_frame).to_compas()
mesh_gripper_base = RhinoMesh.from_geometry(base_mesh).to_compas()
mesh_gripper_jaw_l = RhinoMesh.from_geometry(l_jaw_mesh).to_compas()
mesh_gripper_jaw_r = RhinoMesh.from_geometry(r_jaw_mesh).to_compas()
approach_vector = RhinoVector.from_geometry(approach_vector).to_compas()

robot_model = ParallelGripperFactory(
    None,
    type_name,
    gripper_jaw_position_min,
    gripper_jaw_position_max,
    tool_coordinate_frame = tool_coordinate_frame,
    tool_pick_up_frame = tool_pick_up_frame,
    tool_storage_frame = tool_storage_frame,
    mesh_gripper_base = mesh_gripper_base,
    mesh_gripper_jaw_l = mesh_gripper_jaw_l,
    mesh_gripper_jaw_r = mesh_gripper_jaw_r,
    approach_vector = approach_vector,
    )
# ---------- end create_parallel_gripper_2 ----------

# ----
# Check Path and Environment
compas_version = GhPythonScript()  # -> out, compas_version, compas_fab_version, compas_path, compas_fab_path, compas_env_name, python_directory
# ---------- compas_version: Python ----------
__author__ = "leungp"
__version__ = "2020.04.20"

import rhinoscriptsyntax as rs
import compas
import compas_fab
compas_version  = compas.__version__
compas_fab_version = compas_fab.__version__
import os
compas_path = os.path.abspath(compas.__file__)
compas_fab_path = os.path.abspath(compas_fab.__file__)

import compas_bootstrapper
compas_env_name = compas_bootstrapper.ENVIRONMENT_NAME
python_directory = compas_bootstrapper.PYTHON_DIRECTORY
# ---------- end compas_version ----------
compas_environment_name = Panel(compas_version.compas_env_name)
compas_version_2 = Panel(compas_version.compas_version)
compas_fab_version = Panel(compas_version.compas_fab_version)
compas_path = Panel(compas_version.compas_path)
compas_fab_path = Panel(compas_version.compas_fab_path)
python_directory = Panel(compas_version.python_directory)

# ----
# Test Motion
# Test Full Stroke Movement
_0_0_to_1_0_relative_position = Slider(0, range=0..1)
deepcopy = GhPythonScript(data_in=create_parallel_gripper_2.robot_model)  # -> data_out
# ---------- deepcopy: Python ----------
from copy import deepcopy
data_out = deepcopy(data_in)
# ---------- end deepcopy ----------
set_clamp_state = GhPythonScript(robot_model=deepcopy, gripper_jaw_position_relative=_0_0_to_1_0_relative_position)  # -> out, robot_model_out
# ---------- set_clamp_state: Python ----------
from integral_timber_joints.ghpython.utilities import rPlane2cFrame
from compas_rhino.geometry import RhinoPlane

# Deep copy should be performed before this script
robot_model_out = robot_model

# Set State
if hasattr(robot_model_out,"gripper_jaw_limits"):
    limits = robot_model_out.gripper_jaw_limits
    robot_model_out.gripper_jaw_position = gripper_jaw_position_relative * (limits[1]-limits[0]) + limits[0]
    print (robot_model_out.gripper_jaw_position)
    
if hasattr(robot_model_out,"clamp_jaw_limits"):
    limits = robot_model_out.clamp_jaw_limits
    robot_model_out.clamp_jaw_position = clamp_jaw_position_relative * (limits[1]-limits[0]) + limits[0]
# ---------- end set_clamp_state ----------
robot_artist = GhPythonScript(robot_model=set_clamp_state.robot_model_out)  # -> out, visual
# ---------- robot_artist: Python ----------
from compas_ghpython.helpers import mesh_draw
visual = [mesh_draw(mesh) for mesh in robot_model.draw_visuals()]
# ---------- end robot_artist ----------

# ----
# Test Motion
# Test Full Stroke Movement
_0_0_to_1_0_relative_position_2 = Slider(0, range=0..1)  # disabled
set_clamp_state_2 = GhPythonScript(robot_model=create_parallel_gripper.robot_model, gripper_jaw_position_relative=_0_0_to_1_0_relative_position_2)  # -> out, robot_model_out; disabled
# ---------- set_clamp_state_2: Python ----------
from integral_timber_joints.ghpython.utilities import rPlane2cFrame
from compas_rhino.geometry import RhinoPlane

# Deep copy should be performed before editing
robot_model_out = robot_model.copy()

# Set State
if hasattr(robot_model_out,"gripper_jaw_limits"):
    limits = robot_model_out.gripper_jaw_limits
    robot_model_out.gripper_jaw_position = gripper_jaw_position_relative * (limits[1]-limits[0]) + limits[0]

if hasattr(robot_model_out,"clamp_jaw_limits"):
    limits = robot_model_out.clamp_jaw_limits
    robot_model_out.clamp_jaw_position = clamp_jaw_position_relative * (limits[1]-limits[0]) + limits[0]
# ---------- end set_clamp_state_2 ----------
robot_artist_2 = GhPythonScript(robot_model=set_clamp_state_2.robot_model_out)  # -> out, visual; disabled; same code as robot_artist

# ----
# Test Motion
# Test Full Stroke Movement
_0_0_to_1_0_relative_position_3 = Slider(0, range=0..1)  # disabled
_0_0_to_1_0_relative_position_4 = Slider(1, range=0..1)  # disabled
set_clamp_state_3 = GhPythonScript(
    robot_model=create_clamp.robot_model,
    gripper_jaw_position_relative=_0_0_to_1_0_relative_position_3,
    clamp_jaw_position_relative=_0_0_to_1_0_relative_position_4)  # -> out, robot_model_out; disabled; same code as set_clamp_state_2
robot_artist_3 = GhPythonScript(robot_model=set_clamp_state_3.robot_model_out)  # -> out, visual; disabled; same code as robot_artist

# ----
# Save
# Save location next to Rhino File
# Fle name = tool_name.pickle
auto_path = GhPythonScript(tool_name="PG1")  # -> json_path, pickle_path
# ---------- auto_path: Python ----------
from Rhino.RhinoDoc import ActiveDoc
import os
json_path = os.path.split(ActiveDoc.Path)[0] + os.path.sep + tool_name +".json"
pickle_path = os.path.split(ActiveDoc.Path)[0] + os.path.sep + tool_name +".pickle"
# ---------- end auto_path ----------
save = Button()  # disabled
python = GhPythonScript(robot_model=create_parallel_gripper_2.robot_model, pickle_path=auto_path.pickle_path, output=save)  # -> out, a; disabled
# ---------- python: Python ----------
if output:
    import pickle
    with open(pickle_path, 'wb') as f:
        pickle.dump(robot_model, f, protocol = 2)
# ---------- end python ----------

# ----
# Save
# Save location next to Rhino File
# Fle name = tool_name.pickle
auto_path_2 = GhPythonScript(tool_name="PG2")  # -> json_path, pickle_path; same code as auto_path
save_2 = Button()
python_2 = GhPythonScript(robot_model=create_parallel_gripper.robot_model, json_path=auto_path_2.json_path, output=save_2)  # -> out, a
# ---------- python_2: Python ----------
if output:
    import jsonpickle
    with open(json_path, 'w') as f:
        f.write(jsonpickle.encode(robot_model, keys=True))
# ---------- end python_2 ----------

save_3 = Button()

# ----
# Save
# Save location next to Rhino File
# Fle name = tool_name.pickle
auto_path_3 = GhPythonScript(tool_name="CL1")  # -> json_path, pickle_path; same code as auto_path
save_4 = Button()
python_3 = GhPythonScript(robot_model=create_clamp.robot_model, json_path=auto_path_3.json_path, output=save_4)  # -> out, a; same code as python_2

python_4 = GhPythonScript(robot_model=create_parallel_gripper_2.robot_model, json_path=auto_path.json_path, output=save_3)  # -> out, a; same code as python_2

load_tool = GhPythonScript(pickle_path=auto_path.pickle_path)  # -> out, tool; disabled
# ---------- load_tool: Python ----------
import pickle
with open(pickle_path, 'rb') as f:
    tool = pickle.load(f)
# ---------- end load_tool ----------
python_5 = GhPythonScript(tool=load_tool.tool)  # -> out, links; disabled
# ---------- python_5: Python ----------
links = [link.name for link in tool.links]
# ---------- end python_5 ----------
panel = Panel(python_5.links)  # disabled

load_tool_2 = GhPythonScript(json_path=auto_path.json_path)  # -> out, tool
# ---------- load_tool_2: Python ----------
import jsonpickle
with open(json_path, 'r') as f:
    tool = jsonpickle.decode(f.read(), keys=True)
# ---------- end load_tool_2 ----------
python_6 = GhPythonScript(tool=load_tool_2.tool)  # -> out, links; same code as python_5
panel_2 = Panel(python_6.links)

load_tool_3 = GhPythonScript(json_path=auto_path_3.json_path, x=save_4)  # -> out, tool; same code as load_tool_2
python_7 = GhPythonScript(tool=load_tool_3.tool)  # -> out, links; same code as python_5
panel_3 = Panel(python_7.links)
